# Grasshopper definition anemone_sample.gh (Grasshopper 1.0.7)
# plug-ins: Anemone

# ----
# Step4: n回目の繰り返しのとき、枝分かれの数を変える
# 1.１本目の枝をつくる
construct_point = ConstructPoint(XCoordinate=0, YCoordinate=0, ZCoordinate=0)
unit_z = UnitZ(Factor=1)

# ---- group: Point_Origin
point = Point(construct_point)

# ----
line_sdl = LineSDL(Start=point, Direction=unit_z, Length=Slider(1000, range=0..1000))

# ---- group: Curve_Tree_Parent
curve = Curve(line_sdl)

# ----
loop_start = LoopStart(Repeat=Slider(16, range=0..20), Trigger=Button(), Data=curve)  # -> port, Counter, Data
panel = Panel(loop_start.Counter)

# ---- group: Curve_Tree_Parent
curve_2 = Curve(loop_start.Data)

# ---- group: count
number = Number(loop_start.Counter)

number_2 = Number(number)

# ---- group: Curve_Tree_Parent
curve_3 = Curve(curve)

# ----
# Step3: 枝の長さが一定以下で繰り返しを終える
# 1.１本目の枝をつくる
construct_point_2 = ConstructPoint(XCoordinate=0, YCoordinate=0, ZCoordinate=0)
unit_z_2 = UnitZ(Factor=1)

# ---- group: Point_Origin
point_2 = Point(construct_point_2)

# ----
line_sdl_2 = LineSDL(Start=point_2, Direction=unit_z_2, Length=Slider(1000, range=0..1000))

# ---- group: Curve_Tree_Parent
curve_4 = Curve(line_sdl_2)

# ----
loop_start_2 = LoopStart(Repeat=Slider(16, range=0..20), Trigger=Button(), Data=curve_4)  # -> port, Counter, Data
panel_2 = Panel(loop_start_2.Counter)

# ---- group: Curve_Tree_Parent
curve_5 = Curve(loop_start_2.Data)

curve_6 = Curve(curve_4)

# ----
# Step2: amemoneで繰り返しを仕込む
# 1.１本目の枝をつくる
construct_point_3 = ConstructPoint(XCoordinate=0, YCoordinate=0, ZCoordinate=0)
unit_z_3 = UnitZ(Factor=1)

# ---- group: Point_Origin
point_3 = Point(construct_point_3)

# ----
line_sdl_3 = LineSDL(Start=point_3, Direction=unit_z_3, Length=Slider(1000, range=0..1000))

# ---- group: Curve_Tree_Parent
curve_7 = Curve(line_sdl_3)

# ----
loop_start_3 = LoopStart(Repeat=Slider(10, range=0..10), Trigger=Button(), Data=curve_7)  # -> port, Counter, Data

# ---- group: Curve_Tree_Parent
curve_8 = Curve(loop_start_3.Data)

# ----
# 2.枝分かれをつくる
end_points = EndPoints(Curve=curve_8)  # -> Start, End
length = Length(Curve=curve_8)
point_4 = Point(end_points.End)
vector = Vector(curve_8)
subtraction = Subtraction(A=length, B=Slider(100, range=0..100))
line_sdl_4 = LineSDL(Start=point_4, Direction=vector, Length=subtraction)
point_5 = Point(point_4)
vector_2 = Vector(vector)
curve_9 = Curve(line_sdl_4)
plane_normal = PlaneNormal(Origin=point_5, ZAxis=vector_2)
deconstruct_plane = DeconstructPlane(Plane=plane_normal)  # -> Origin, XAxis, YAxis, ZAxis
construct_plane = ConstructPlane(Origin=deconstruct_plane.Origin, XAxis=deconstruct_plane.XAxis, YAxis=deconstruct_plane.ZAxis)
curve_10 = Curve(curve_9)
plane = Plane(construct_plane)
plane_2 = Plane(plane_normal)
number_3 = Number(Slider(20, range=0..100))
rotate = Rotate(Geometry=curve_10, Angle=degrees(number_3), Plane=plane)  # -> Geometry, Transform
construct_domain = ConstructDomain(DomainStart="0", DomainEnd="360")
random = Random(Range=construct_domain, Number="2", Seed=2, Integers=True)
plane_3 = Plane(plane_2)
number_4 = Number(random)
rotate_2 = Rotate(Geometry=rotate.Geometry, Angle=degrees(number_4), Plane=plane_3)  # -> Geometry, Transform
graft_tree = GraftTree(Tree=rotate_2.Geometry, IncludeEmptyLists=True, IncludeNullItems=True)  # -> simplify(Tree)

# ---- group: Curve_Tree_Branch
curve_11 = Curve(graft_tree)

# ----
loop_end = LoopEnd(port=loop_start_3.port, Exit=False, Data=curve_11, TimeOutVal=0, pausedState=False, state="Constant & Record")

# ---- group: Curve_Tree_Parent
curve_12 = Curve(curve_7)

# ---- group: Curve_Tree_Branch
curve_13 = Curve(loop_end)

# ----
merge = Merge(Data1=curve_12, Data2=curve_13)

# ----
# Step1: 繰り返したい処理の中身をつくる
# 1.１本目の枝をつくる
construct_point_4 = ConstructPoint(XCoordinate=0, YCoordinate=0, ZCoordinate=0)
unit_z_4 = UnitZ(Factor=1)

# ---- group: Point_Origin
point_6 = Point(construct_point_4)

# ----
line_sdl_5 = LineSDL(Start=point_6, Direction=unit_z_4, Length=Slider(1000, range=0..1000))

# ---- group: Curve_Tree_Parent
curve_14 = Curve(line_sdl_5)

curve_15 = Curve(curve_14)

# ----
# 2.枝分かれをつくる
end_points_2 = EndPoints(Curve=curve_15)  # -> Start, End
length_2 = Length(Curve=curve_15)
point_7 = Point(end_points_2.End)
vector_3 = Vector(curve_15)
subtraction_2 = Subtraction(A=length_2, B=Slider(100, range=0..100))
line_sdl_6 = LineSDL(Start=point_7, Direction=vector_3, Length=subtraction_2)
point_8 = Point(point_7)
vector_4 = Vector(vector_3)
curve_16 = Curve(line_sdl_6)
plane_normal_2 = PlaneNormal(Origin=point_8, ZAxis=vector_4)
deconstruct_plane_2 = DeconstructPlane(Plane=plane_normal_2)  # -> Origin, XAxis, YAxis, ZAxis
construct_plane_2 = ConstructPlane(Origin=deconstruct_plane_2.Origin, XAxis=deconstruct_plane_2.XAxis, YAxis=deconstruct_plane_2.ZAxis)
curve_17 = Curve(curve_16)
plane_4 = Plane(construct_plane_2)
plane_5 = Plane(plane_normal_2)
number_5 = Number(Slider(20, range=0..100))
rotate_3 = Rotate(Geometry=curve_17, Angle=degrees(number_5), Plane=plane_4)  # -> Geometry, Transform
construct_domain_2 = ConstructDomain(DomainStart="0", DomainEnd="360")
random_2 = Random(Range=construct_domain_2, Number="2", Seed=2, Integers=True)
plane_6 = Plane(plane_5)
number_6 = Number(random_2)
rotate_4 = Rotate(Geometry=rotate_3.Geometry, Angle=degrees(number_6), Plane=plane_6)  # -> Geometry, Transform
graft_tree_2 = GraftTree(Tree=rotate_4.Geometry, IncludeEmptyLists=True, IncludeNullItems=True)  # -> simplify(Tree)

# ---- group: Curve_Tree_Branch
curve_18 = Curve(graft_tree_2)

# ----
# 2.枝分かれをつくる
end_points_3 = EndPoints(Curve=curve_2)  # -> Start, End
length_3 = Length(Curve=curve_2)
point_9 = Point(end_points_3.End)
vector_5 = Vector(curve_2)
subtraction_3 = Subtraction(A=length_3, B=Slider(100, range=0..100))
line_sdl_7 = LineSDL(Start=point_9, Direction=vector_5, Length=subtraction_3)
point_10 = Point(point_9)
vector_6 = Vector(vector_5)
curve_19 = Curve(line_sdl_7)
plane_normal_3 = PlaneNormal(Origin=point_10, ZAxis=vector_6)
deconstruct_plane_3 = DeconstructPlane(Plane=plane_normal_3)  # -> Origin, XAxis, YAxis, ZAxis
construct_plane_3 = ConstructPlane(Origin=deconstruct_plane_3.Origin, XAxis=deconstruct_plane_3.XAxis, YAxis=deconstruct_plane_3.ZAxis)
construct_domain_3 = ConstructDomain(DomainStart="0", DomainEnd="360")
construct_domain_4 = ConstructDomain(DomainStart="0", DomainEnd="360")
modulus = Modulus(A=number_2, B="3")
plane_7 = Plane(plane_normal_3)
number_7 = Number(Slider(20, range=0..100))
curve_20 = Curve(curve_19)
plane_8 = Plane(construct_plane_3)
equality = Equality(FirstNumber=modulus, SecondNumber="0")  # -> Equality, Inequality
random_3 = Random(Range=construct_domain_3, Number="2", Seed=2, Integers=True)
random_4 = Random(Range=construct_domain_4, Number="5", Seed=2, Integers=True)
rotate_5 = Rotate(Geometry=curve_20, Angle=degrees(number_7), Plane=plane_8)  # -> Geometry, Transform
number_8 = Number(random_3)
number_9 = Number(random_4)
stream_filter = StreamFilter(Gate=equality.Equality, Stream0=number_8, Stream1=number_9)
plane_9 = Plane(plane_7)

number_10 = Number(stream_filter)

# ----
# 2.枝分かれをつくる
end_points_4 = EndPoints(Curve=curve_5)  # -> Start, End
length_4 = Length(Curve=curve_5)
point_11 = Point(end_points_4.End)
vector_7 = Vector(curve_5)
subtraction_4 = Subtraction(A=length_4, B=Slider(100, range=0..100))
line_sdl_8 = LineSDL(Start=point_11, Direction=vector_7, Length=subtraction_4)
point_12 = Point(point_11)
vector_8 = Vector(vector_7)
curve_21 = Curve(line_sdl_8)
plane_normal_4 = PlaneNormal(Origin=point_12, ZAxis=vector_8)
deconstruct_plane_4 = DeconstructPlane(Plane=plane_normal_4)  # -> Origin, XAxis, YAxis, ZAxis
construct_plane_4 = ConstructPlane(Origin=deconstruct_plane_4.Origin, XAxis=deconstruct_plane_4.XAxis, YAxis=deconstruct_plane_4.ZAxis)
curve_22 = Curve(curve_21)
plane_10 = Plane(construct_plane_4)
plane_11 = Plane(plane_normal_4)
number_11 = Number(Slider(20, range=0..100))
rotate_6 = Rotate(Geometry=curve_22, Angle=degrees(number_11), Plane=plane_10)  # -> Geometry, Transform
construct_domain_5 = ConstructDomain(DomainStart="0", DomainEnd="360")
random_5 = Random(Range=construct_domain_5, Number="2", Seed=2, Integers=True)
plane_12 = Plane(plane_11)
number_12 = Number(random_5)
rotate_7 = Rotate(Geometry=rotate_6.Geometry, Angle=degrees(number_12), Plane=plane_12)  # -> Geometry, Transform
graft_tree_3 = GraftTree(Tree=rotate_7.Geometry, IncludeEmptyLists=True, IncludeNullItems=True)  # -> simplify(Tree)

# ---- group: Curve_Tree_Branch
curve_23 = Curve(graft_tree_3)

curve_24 = Curve(graft_tree_3)

# ----
length_5 = Length(Curve=curve_23)
list_item = ListItem(List=flatten(length_5), Index=0, Wrap=True)
smaller_than = SmallerThan(FirstNumber=list_item, SecondNumber="50")  # -> SmallerThan, OrEqualTo
boolean = Boolean(smaller_than.SmallerThan)
panel_3 = Panel(boolean)

loop_end_2 = LoopEnd(port=loop_start_2.port, Exit=boolean, Data=curve_24, TimeOutVal=0, pausedState=False, state="Constant & Record")

# ---- group: Curve_Tree_Branch
curve_25 = Curve(loop_end_2)

# ----
merge_2 = Merge(Data1=curve_6, Data2=curve_25)

rotate_8 = Rotate(Geometry=rotate_5.Geometry, Angle=degrees(number_10), Plane=plane_9)  # -> Geometry, Transform
graft_tree_4 = GraftTree(Tree=rotate_8.Geometry, IncludeEmptyLists=True, IncludeNullItems=True)  # -> simplify(Tree)

# ---- group: Curve_Tree_Branch
curve_26 = Curve(graft_tree_4)

curve_27 = Curve(graft_tree_4)

# ----
length_6 = Length(Curve=curve_26)
list_item_2 = ListItem(List=flatten(length_6), Index=0, Wrap=True)
smaller_than_2 = SmallerThan(FirstNumber=list_item_2, SecondNumber="50")  # -> SmallerThan, OrEqualTo
boolean_2 = Boolean(smaller_than_2.SmallerThan)
panel_4 = Panel(boolean_2)

loop_end_3 = LoopEnd(port=loop_start.port, Exit=boolean_2, Data=curve_27, TimeOutVal=0, pausedState=False, state="Constant & Record")

# ---- group: Curve_Tree_Branch
curve_28 = Curve(loop_end_3)

# ----
merge_3 = Merge(Data1=curve_3, Data2=curve_28)
